# Grasshopper definition S2.3-Tower_script.gh (Grasshopper 1.0.7)
# plug-ins: Kangaroo2 Components

top_ring_diameter = Slider(20.262, range=0..100)
number_of_branches = Slider(21, range=0..30)
number_of_iterations = Slider(24, range=0..30)
top_ring_height = Slider(100, range=0..100)
middle_ring_height = Slider(21.775, range=0..30)
lower_ring_diameter = Slider(28.878, range=0..30)
middle_ring_diameter = Slider(24.83, range=0..30)

# ----
# Data Management assignment
# 15/FEB/2022
inputs = Data("INPUTS")
process = Data("PROCESS")
height = GetNumber(top_ring_height, AtLeast=1, AtMost=1, Maximum=1.797693135e+308, Minimum=-1.797693135e+308, Prompt="Height")
diameter = GetNumber(top_ring_diameter, AtLeast=1, AtMost=1, Maximum=1.797693135e+308, Minimum=-1.797693135e+308)
outputs = Data("OUTPUTS")
pt = PointXYZ(XComponent=0, YComponent=0, ZComponent=middle_ring_height)
pt_2 = PointXYZ(XComponent=0, YComponent=0, ZComponent=height)
xy = XYPlane(Origin=pt)
xy_2 = XYPlane(Origin=pt_2)
cir = Circle(Plane=xy, Radius=middle_ring_diameter)
cir_2 = Circle(Plane=PlaneXY(0, 0, 0), Radius=lower_ring_diameter)
cir_3 = Circle(Plane=xy_2, Radius=diameter)
curvepoint = PointOnCurve(cir_2, parameter=0.372)
curvepoint_2 = PointOnCurve(cir, parameter=0.365)
curvepoint_3 = PointOnCurve(cir_3, parameter=0.54)
interpolate = Interpolate(Vertices=[curvepoint, curvepoint_2, curvepoint_3], Degree=3, Periodic=False, KnotStyle=1)  # -> Curve, Length, Domain
divide = DivideCurve(Curve=interpolate.Curve, Number=number_of_branches, Kinks=False)  # -> Points, Tangents, Parameters
pcomp = Decompose(Point=divide.Points)  # -> XComponent, YComponent, ZComponent
pt_3 = PointXYZ(XComponent=0, YComponent=0, ZComponent=pcomp.ZComponent)
xy_3 = XYPlane(Origin=pt_3)
cir_4 = Circle(Plane=xy_3, Radius=pcomp.XComponent)
divide_2 = DivideCurve(Curve=cir_4, Number=number_of_iterations, Kinks=False)  # -> Points, Tangents, Parameters
series = Series(Start=0, Step=expr("x+1", number_of_iterations), Count=expr("x+1", number_of_branches))
flatten = FlattenTree(Data=divide_2.Points, Path="{0}")
series_2 = Series(Start=0, Step=expr("(2*π)/x", number_of_iterations), Count=number_of_iterations)
list_item = ListItem(List=flatten, Index=series, Wrap=Toggle(False))
interpolate_2 = Interpolate(Vertices=list_item, Degree=3, Periodic=False, KnotStyle=1)  # -> Curve, Length, Domain
pt_4 = Point(Point(0, 0, 0))
rot3d = Rotate3D(Geometry=interpolate_2.Curve, Angle=series_2, Center=pt_4, Axis=Vector(0, 0, 1))  # -> Geometry, Transform
yz = YZPlane(Origin=Point(0, 0, 0))
mirror = Mirror(Geometry=rot3d.Geometry, Plane=yz)  # -> Geometry, Transform
crv = Curve([rot3d.Geometry, mirror.Geometry])

# ---- group: RH_OUT:Mesh
mp = MultiPipe(
    Curves=crv,
    NodeSize=Slider(2.21, range=0.01..100),
    EndOffset=1,
    StrutSize=Slider(0.27, range=0.01..2),
    Segment=0,
    KinkAngle=0.6,
    CubeFit=0,
    Caps=Slider(2, range=0..10))
